# Grasshopper definition slicer.ghx (Grasshopper 0.8.63)

contour_angle = Slider(180, range=0..180)
contour_size = Slider(13.133, range=1..20)
thickness = Slider(1, range=0.1..2)
surface_a = Surface(<surface referenced from the Rhino model>)
surface_b = Surface(<surface referenced from the Rhino model>)
addition = Addition(A=contour_angle, B=90)
vrot = Rotate(Vector=Vector(0, 1, 0), Axis=Vector(0, 0, 1), Angle=expr("Rad(A)", [contour_angle, addition]))  # -> simplify(Vector)
vrot_2 = Rotate(Vector=Vector(0, 1, 0), Axis=Vector(0, 0, 1), Angle=expr("Rad(A)", [contour_angle, addition]))  # -> simplify(Vector)
area = Area(Geometry=surface_b)  # -> Area, Centroid
contour = Contour(Shape=surface_b, Point=area.Centroid, Direction=vrot, Distance=contour_size)
contour_2 = Contour(Shape=surface_a, Point=area.Centroid, Direction=vrot_2, Distance=contour_size)
edgesrf = EdgeSurface(CurveA=contour_2, CurveB=contour)
edges = BrepEdges(Brep=edgesrf)  # -> Naked, Interior, NonManifold
vector_a = ListItem(List=vrot, Index=1, Wrap=False)
vector_b = ListItem(List=vrot, Index=0, Wrap=False)
join = JoinCurves(Curves=edges.Naked, Preserve=False)  # -> simplify(Curves)
dom = Domain(DomainStart=expr("-A/2", thickness), DomainEnd=expr("B/2", thickness))
pshift = ShiftPaths(Data=join, Offset=-1)
A = TreeBranch(Tree=pshift, Path="{0}")
B = TreeBranch(Tree=pshift, Path="{1}")
ccx = CurveCurve(CurveA=graft(B), CurveB=flatten(A))  # -> Points, ParamsA, ParamsB
ccx_2 = CurveCurve(CurveA=graft(A), CurveB=flatten(B))  # -> Points, ParamsA, ParamsB
pshift_2 = ShiftPaths(Data=ccx_2.Points, Offset=-1)
pshift_3 = ShiftPaths(Data=ccx.Points, Offset=-1)
clean = CleanTree(Data=pshift_2, CleanInvalid=True, CleanEmpty=True)  # -> simplify(Data)
clean_2 = CleanTree(Data=pshift_3, CleanInvalid=True, CleanEmpty=True)  # -> simplify(Data)
dispatch = Dispatch(List=clean, DispatchPattern=[True, False])  # -> ListA, ListB
dist = Distance(PointA=dispatch.ListA, PointB=dispatch.ListB)
dom_2 = Domain(DomainStart=expr("-A/2", dist), DomainEnd=expr("B/2", dist))
dispatch_2 = Dispatch(List=clean_2, DispatchPattern=[True, False])  # -> ListA, ListB
dist_2 = Distance(PointA=dispatch_2.ListA, PointB=dispatch_2.ListB)
dom_3 = Domain(DomainStart=expr("-A/2", dist_2), DomainEnd=expr("B/2", dist_2))
plane_b = Plane(Origin=dispatch_2.ListA, XAxis=vector_b, YAxis=Vector(0, 0, 1))
plane_a = Plane(Origin=dispatch.ListB, XAxis=vector_a, YAxis=Vector(0, 0, 1))
A_2 = TreeBranch(Tree=pshift, Path="{0}")  # -> simplify(graft(Branch))
B_2 = TreeBranch(Tree=pshift, Path="{1}")  # -> simplify(graft(Branch))
rectangle = Rectangle(Plane=plane_a, XSize=dom, YSize=dom_2, Radius=0)  # -> Rectangle, Length
rectangle_2 = Rectangle(Plane=plane_b, XSize=dom, YSize=dom_3, Radius=0)  # -> Rectangle, Length
trim = TrimWithRegions(Curve=B_2, Regions=rectangle_2.Rectangle)  # -> Inside, Outside
trim_2 = TrimWithRegions(Curve=rectangle_2.Rectangle, Regions=B_2)  # -> Inside, Outside
trim_3 = TrimWithRegions(Curve=A_2, Regions=rectangle.Rectangle)  # -> Inside, Outside
trim_4 = TrimWithRegions(Curve=rectangle.Rectangle, Regions=A_2)  # -> Inside, Outside
crv = Curve(trim_4.Inside)
crv_2 = Curve(trim_3.Outside)
crv_3 = Curve(trim_2.Inside)
crv_4 = Curve(trim.Outside)
join_2 = JoinCurves(Curves=flatten([crv_2, crv]), Preserve=False)  # -> simplify(flatten(Curves))
join_3 = JoinCurves(Curves=flatten([crv_4, crv_3]), Preserve=False)  # -> simplify(flatten(Curves))
planar = PlanarSrf(Edges=join_2)
planar_2 = PlanarSrf(Edges=join_3)
