# Grasshopper definition Bracelet.gh (Grasshopper 0.9.76)
# plug-ins: MeshEdit Components, Weaverbird

series = Series(Start=0, Step=Slider(10, range=0..10), Count=10)
cir = Circle(Plane=PlaneXY(0, 0, 0), Radius=Slider(7, range=0..10))
vec = VectorXYZ(XComponent=0, YComponent=0, ZComponent=series)  # -> Vector, Length
panel = Panel(vec.Vector)
move = Move(Geometry=cir, Motion=vec.Vector)  # -> Geometry, Transform
area = Area(Geometry=move.Geometry)  # -> Area, Centroid
pt = Point(<point referenced from the Rhino model>)
dist = Distance(PointA=area.Centroid, PointB=pt)
bnd = Bounds(Numbers=dist)
dom = ConstructDomain(DomainStart=Slider(1, range=0..5), DomainEnd=Slider(5, range=0..5))
remap = RemapNumbers(Value=dist, Source=bnd, Target=dom)  # -> Mapped, Clipped
graph = GraphMapper(remap.Mapped, x0=0, x1=4, y0=0, y1=2, container_name="Sine", Equation_px=[0, 1], Equation_py=[0.3623188436, 1])
scale = Scale(Geometry=move.Geometry, Center=area.Centroid, Factor=graph)  # -> Geometry, Transform
loft = Loft(Curves=scale.Geometry, Options={Adjust=False, Closed=False, LoftEnds=0, LoftSimp=0, LoftType=0, Rebuild=10, Refit=0.01})
panel_2 = Panel(graph)

divide = DivideDomain²(Domain=loft, UCount=Slider(2, range=0..100), VCount=Slider(8, range=0..100))
subsrf = Isotrim(Surface=loft, Domain=divide)

md_slider = MDSlider(
    slider_value=Point(0.736000061, 0.472319603, 0.5),
    SliderMode=0,
    x_domain=Domain(0, 1),
    y_domain=Domain(0, 1),
    z_domain=Domain(0, 1))
evalsrf = EvaluateSurface(Surface=reparameterize(graft(subsrf)), Point=md_slider)  # -> Point, Normal, Frame
pt_2 = Point(evalsrf.Point)
number_slider = Slider(0.7, range=0..1)
triangle = MeshTriangle(CornerA=0, CornerB=1, CornerC=2)
triangle_2 = MeshTriangle(CornerA=0, CornerB=1, CornerC=2)
mjoin = MeshJoin()

avr = Average(Input=area.Centroid)
cir_2 = Circle(Plane=avr, Radius=Slider(30, range=0..30))

eval = EvaluateCurve(Curve=reparameterize(cir_2), Parameter=Slider(0.5, range=0..1))  # -> Point, Tangent, Angle

dist_2 = Distance(PointA=pt_2, PointB=eval.Point)  # -> simplify(flatten(Distance))

bnd_2 = Bounds(Numbers=dist_2)
dom_2 = ConstructDomain(DomainStart=Slider(0, range=0..100), DomainEnd=Slider(100, range=0..100))
remap_2 = RemapNumbers(Value=dist_2, Source=bnd_2, Target=dom_2)  # -> Mapped, Clipped

ln = Line(StartPoint=pt_2, EndPoint=eval.Point)

bnd_3 = Bounds(Numbers=dist_2)
dom_3 = ConstructDomain(DomainStart=Slider(9, range=0..100), DomainEnd=Slider(0.117, range=0..10))
remap_3 = RemapNumbers(Value=dist_2, Source=bnd_3, Target=dom_3)  # -> Mapped, Clipped

neg = Negative(Value=remap_3.Mapped)
larger = LargerThan(FirstNumber=remap_2.Mapped, SecondNumber=Slider(64, range=0..100))  # -> LargerThan, OrEqualTo

# ---- group: punti
dispatch = Dispatch(List=pt_2, DispatchPattern=graft(larger.LargerThan))  # -> ListA, ListB
pt_3 = Point(simplify(dispatch.ListB))
pt_4 = Point(simplify(dispatch.ListA))

# ---- group: surface
dispatch_2 = Dispatch(List=simplify(graft(subsrf)), DispatchPattern=graft(larger.LargerThan))  # -> simplify(ListA), simplify(ListB)
clean = CleanTree(RemoveNulls=True, RemoveInvalid=True, RemoveEmpty=Toggle(True), Tree=dispatch_2.ListA)
clean_2 = CleanTree(RemoveNulls=True, RemoveInvalid=True, RemoveEmpty=Toggle(True), Tree=dispatch_2.ListB)

# ---- group: normal
dispatch_3 = Dispatch(List=simplify(graft(evalsrf.Frame)), DispatchPattern=graft(larger.LargerThan))  # -> simplify(ListA), simplify(ListB)
clean_3 = CleanTree(RemoveNulls=True, RemoveInvalid=True, RemoveEmpty=Toggle(True), Tree=dispatch_3.ListA)
clean_4 = CleanTree(RemoveNulls=True, RemoveInvalid=True, RemoveEmpty=Toggle(True), Tree=dispatch_3.ListB)

# ---- group: punti
clean_5 = CleanTree(RemoveNulls=True, RemoveInvalid=True, RemoveEmpty=Toggle(True), Tree=pt_4)
clean_6 = CleanTree(RemoveNulls=True, RemoveInvalid=True, RemoveEmpty=Toggle(True), Tree=pt_3)

# ----
explode = Explode(Curve=clean_2, Recursive=True)  # -> simplify(Segments), simplify(Vertices)
explode_2 = Explode(Curve=explode.Segments, Recursive=True)  # -> Segments, simplify(Vertices)

# ---- group: distance
dispatch_4 = Dispatch(List=graft(neg), DispatchPattern=graft(larger.LargerThan))  # -> simplify(ListA), simplify(ListB)
clean_7 = CleanTree(RemoveNulls=True, RemoveInvalid=True, RemoveEmpty=Toggle(True), Tree=dispatch_4.ListA)
clean_8 = CleanTree(RemoveNulls=True, RemoveInvalid=True, RemoveEmpty=Toggle(True), Tree=dispatch_4.ListB)

# ----
number_slider_2 = Slider(-2, range=-2..0)
line = LineSDL(Start=clean_6, Direction=clean_4, Length=clean_8)
end = EndPoints(Curve=line)  # -> Start, End

explode_3 = Explode(Curve=clean, Recursive=True)  # -> simplify(Segments), simplify(Vertices)
item = ListItem(List=explode_3.Vertices, Index=0, Wrap=True)
item_2 = ListItem(List=explode_3.Vertices, Index=Slider(1, range=0..3), Wrap=True)
item_3 = ListItem(List=explode_3.Vertices, Index=Slider(2, range=0..3), Wrap=True)
item_4 = ListItem(List=explode_3.Vertices, Index=Slider(3, range=0..3), Wrap=True)
pt_5 = Point(simplify(end.End))
item_5 = ListItem(List=explode_2.Vertices, Index=0, Wrap=True)
item_6 = ListItem(List=explode_2.Vertices, Index=Slider(1, range=0..1), Wrap=True)
panel_3 = Panel(explode_2.Vertices)
repeat = RepeatData(Data=pt_5, Length=Slider(4, range=0..10))  # -> graft(Data)
path_mapper = PathMapper(repeat, source="{A;B;C}", target="{A;C}")

triangle_3 = MeshTriangle(CornerA=0, CornerB=1, CornerC=2)
conmesh = ConstructMesh(Vertices=[path_mapper, item_5, item_6], Faces=triangle_3)

quad = MeshQuad(CornerA=0, CornerB=1, CornerC=2, CornerD=3)
conmesh_2 = ConstructMesh(Vertices=[item, item_2, item_3, item_4], Faces=quad)

flip = MeshFlip(Mesh=conmesh)
flip_2 = MeshFlip(Mesh=conmesh_2)
mesh = Mesh(flip)
mesh_2 = Mesh(flip_2)
panel_4 = Panel(mesh)
panel_5 = Panel(mesh_2)

mjoin_2 = MeshJoin(Meshes=flatten([mesh, mesh_2]))

wbcatmullclark = WeaverbirdsCatmullClarkSubdivision(MeshCurves=mjoin_2, Level=1, SmoothNakedEdges=1)

medges = MeshEdges(Mesh=wbcatmullclark)  # -> NakedEdges, InteriorEdges, NonManifoldEdges
crv = Curve(medges.NakedEdges)
join = JoinCurves(Curves=crv, Preserve=False)
area_2 = MeshArea(Mesh=join)  # -> Area, Centroid
item_7 = ListItem(List=area_2.Centroid, Index=0, Wrap=True)

wbcatmullclark_2 = WeaverbirdsCatmullClarkSubdivision(MeshCurves=mjoin_2, Level=Slider(2, range=0..10), SmoothNakedEdges=Slider(1, range=0..2))
panel_6 = Panel(join)
scale_nu = ScaleNU(Geometry=mjoin_2, Plane=item_7, ScaleX=number_slider, ScaleY=number_slider, ScaleZ=Slider(0.95, range=0..1))  # -> Geometry, Transform
mjoin_3 = MeshJoin(Meshes=flatten(scale_nu.Geometry))
medges_2 = MeshEdges(Mesh=mjoin_3)  # -> NakedEdges, InteriorEdges, NonManifoldEdges
crv_2 = Curve(medges_2.NakedEdges)
join_2 = JoinCurves(Curves=crv_2, Preserve=False)
item_8 = ListItem(List=join_2, Index=0, Wrap=True)
item_9 = ListItem(List=join, Index=0, Wrap=True)
item_10 = ListItem(List=join_2, Index=Slider(1, range=0..1), Wrap=True)
item_11 = ListItem(List=join, Index=Slider(1, range=0..1), Wrap=True)
explode_4 = Explode(Curve=item_8, Recursive=True)  # -> graft(Segments), Vertices
explode_5 = Explode(Curve=item_9, Recursive=True)  # -> graft(Segments), Vertices
area_3 = Area(Geometry=item_10)  # -> Area, simplify(flatten(Centroid))
explode_6 = Explode(Curve=item_10, Recursive=True)  # -> simplify(graft(Segments)), simplify(Vertices)
panel_8 = Panel(explode_6.Segments)
area_4 = Area(Geometry=item_11)  # -> Area, simplify(flatten(Centroid))
explode_7 = Explode(Curve=item_11, Recursive=True)  # -> simplify(graft(Segments)), Vertices
panel_9 = Panel(explode_5.Vertices)
end_2 = EndPoints(Curve=explode_4.Segments)  # -> Start, End
end_3 = EndPoints(Curve=explode_5.Segments)  # -> Start, End
flatten = FlattenTree(Tree=explode_6.Segments, Path="{0}")
flatten_2 = FlattenTree(Tree=explode_7.Segments, Path="{0}")

# ---- group: soluzione facile e sbagliata!
loft_2 = Loft(
    Curves=[item_9, item_8],
    Options={Adjust=False, Closed=False, LoftEnds=0, LoftSimp=0, LoftType=0, Rebuild=10, Refit=0.01})  # disabled
smesh = SimpleMesh(Brep=loft_2)  # disabled
mesh_3 = MeshBrep(
    Brep=loft_2,
    Settings={GridMaxCount=0, GridMinCount=16, JaggedSeams=False, MaxEdgeLength=0, MinEdgeLength=0.0001, MinTolerance=0, Refine=True, RefineAngle=0, RelativeTolerance=0.65, SimplePlanes=True, Tolerance=0})  # disabled

# ----
lng = ListLength(List=flatten)

# ---- group: elegance
quad_2 = MeshQuad(CornerA=0, CornerB=1, CornerC=2, CornerD=3)
conmesh_3 = ConstructMesh(Vertices=[end_3.Start, end_3.End, end_2.End, end_2.Start], Faces=quad_2)

# ----
lng_2 = ListLength(List=flatten_2)
repeat_2 = RepeatData(Data=area_3.Centroid, Length=lng)  # -> simplify(graft(Data))
repeat_3 = RepeatData(Data=area_4.Centroid, Length=lng_2)  # -> simplify(graft(Data))
end_4 = EndPoints(Curve=explode_6.Segments)  # -> Start, End
end_5 = EndPoints(Curve=explode_7.Segments)  # -> Start, End
conmesh_4 = ConstructMesh(Vertices=[repeat_2, end_4.Start, end_4.End], Faces=triangle)
conmesh_5 = ConstructMesh(Vertices=[repeat_3, end_5.Start, end_5.End], Faces=triangle_2)
flip_3 = MeshFlip(Mesh=conmesh_5)
