# Grasshopper definition CODEGH2D.gh (Grasshopper 0.9.76)
# plug-ins: TT Toolbox

crv = Curve(<curve referenced from the Rhino model>)
topoly = CurveToPolyline(Curve=crv, ToleranceDistance=0, ToleranceAngle=0)  # -> Polyline, Segments
explode = Explode(Curve=topoly.Polyline, Recursive=True)  # -> Segments, Vertices
pshift = ShiftPaths(Data=explode.Vertices, Offset=-1)
pt = Point(pshift)
cullduppoints = RemoveDuplicatePoints(InputPoints=pt, Tolerance=0.001)  # -> OutputPoints, FirstPointIndexes
alongcrv = SortAlongCurve(Points=cullduppoints.OutputPoints, Curve=crv)  # -> Points, Indices
pdecon = Deconstruct(Point=alongcrv.Points)  # -> XComponent, YComponent, ZComponent
sort = SortList(Keys=pdecon.XComponent, ValuesA=alongcrv.Points)  # -> Keys, ValuesA
item = ListItem(List=sort.ValuesA, Index=0, Wrap=True)
points = PointList(Points=sort.ValuesA)
crv_cp = CurveClosestPoint(Point=item, Curve=topoly.Polyline)  # -> Point, Parameter, Distance
circle = CircleCNR(Center=crv_cp.Point, Normal=Vector(0, 0, 1), Radius=Slider(0, range=0..1))
trim = TrimWithRegions(Curve=topoly.Polyline, Regions=circle)  # -> Inside, Outside
crv_2 = Curve(trim.Outside)
explode_2 = Explode(Curve=crv_2, Recursive=True)  # -> Segments, simplify(graft(Vertices))
panel = Panel(explode_2.Vertices)
points_2 = PointList(Points=explode_2.Vertices)
pdecon_2 = Deconstruct(Point=explode_2.Vertices)  # -> simplify(XComponent), simplify(YComponent), ZComponent
repeat = RepeatData(Data=pdecon_2.ZComponent, Length=Slider(2, range=0..10))  # -> simplify(Data)
panel_2 = Panel([pdecon_2.XComponent, pdecon_2.YComponent, repeat])
panel_3 = Panel(pdecon_2.ZComponent)
txt = Text(panel_2)
item_2 = ListItem(List=txt, Index=0, Wrap=True)  # -> Item, Item1, Item2, Item3
concat = Concatenate(
    FragmentH="/move?position=[",
    FragmentA=item_2.Item,
    FragmentE=",",
    FragmentB=item_2.Item1,
    FragmentF=",",
    FragmentC=item_2.Item2,
    FragmentG=",",
    FragmentD=item_2.Item3,
    FragmentI="]&velocity=1")
panel_4 = Panel(concat)
