# Grasshopper definition CODEGH3D.gh (Grasshopper 0.9.76)
# plug-ins: Python Interpreter

# ---- group: sections height
number_slider = Slider(1, range=0..10)

# ---- group: tool diameter
number_slider_2 = Slider(1, range=0..1)

# ----
number_slider_3 = Slider(16, range=0..100)
series = Series(Start=0, Step=number_slider_2, Count=number_slider_3)
series_2 = Series(Start=0, Step=1, Count=number_slider_3)
pt = ConstructPoint(XCoordinate=series, YCoordinate=graft(series_2), ZCoordinate=0)
flip = FlipMatrix(Data=pt)
points = PointList(Points=flip)
pline = PolyLine(Vertices=flip, Closed=False)

hull = ConvexHull(Points=flatten(pt), Plane=PlaneXY(0, 0, 0))  # -> Hull, HullZ, Indices
area = Area(Geometry=hull.Hull)  # -> Area, Centroid
pt_2 = ConstructPoint(XCoordinate=0, YCoordinate=0, ZCoordinate=0)
vec2pt = Vector2Pt(PointA=area.Centroid, PointB=pt_2, Unitize=False)  # -> Vector, Length
move = Move(Geometry=pline, Motion=vec2pt.Vector)  # -> flatten(Geometry), Transform

Z = UnitZ(Factor=1)
geo = Geometry(<brep referenced from the Rhino model>)
contour = Contour(Shape=geo, Point=Point(0, 0, 0), Direction=Z, Distance=number_slider)  # -> flatten(Contours)
boundary = BoundarySurfaces(Edges=contour)
mesh = Mesh(boundary)
python = PythonScript(bld=mesh)  # -> out, a, b; inputs bld: list of Mesh
# ---------- python: Python ----------
import rhinoscriptsyntax as rs

dsZ=[]
dsFloorKey=[]
dsFloors=[]
msFloors=[]

for b in range(0,len(bld)):
    
    ptsCentroid=rs.MeshAreaCentroid(bld[b])
    dZ= ptsCentroid[2]
    dsZ.append(dZ)

for dz in dsZ:
    
    if dz not in dsFloorKey:
        dsFloorKey.append(dz)


for fk in dsFloorKey:
    
    dCentZ=[]
    mCentF=[]
    
    for zF in range (0, len(dsZ)):
        
        if fk == dsZ[zF]:
            
            dCentZ.append(dsZ[zF])
            mCentF.append(bld[zF])
    
    dsFloors.append(dCentZ)
    msFloors.append(mCentF)

iUnitFloorLen = []

for fU in dsFloors:
    iUnitFloorLen.append(len(fU))

a= iUnitFloorLen
# ---------- end python ----------
partition = PartitionList(List=boundary, Size=python.a)  # -> simplify(Chunks)
project = Project(Curve=move.Geometry, Brep=partition, Direction=Vector(0, 0, 1))

pshift = ShiftPaths(Data=project, Offset=-1)
tstat = TreeStatistics(Tree=pshift)  # -> Paths, Length, Count
rev = ReverseList(List=tstat.Paths)
branch = TreeBranch(Tree=pshift, Path=rev, MaintainPaths=False)

end = EndPoints(Curve=branch)  # -> Start, End

pt_3 = Point(end.End)
python_2 = PythonScript(bld=pt_3)  # -> out, a, b; inputs bld: list of Point3d
# ---------- python_2: Python ----------
import rhinoscriptsyntax as rs

dsZ=[]
dsFloorKey=[]
dsFloors=[]
msFloors=[]

for b in bld:
    
    ptsCentroid= b

    dZ= round(ptsCentroid[0],2)
    dsZ.append(dZ)


for dz in dsZ:
    
    if dz not in dsFloorKey:
        dsFloorKey.append(dz)


for fk in dsFloorKey:
    
    dCentZ=[]
    
    for zF in range (0, len(dsZ)):
        
        if fk == dsZ[zF]:
            
            dCentZ.append(dsZ[zF])
    dsFloors.append(dCentZ)
    print dsFloors


iUnitFloorLen = []

for fU in dsFloors:
    iUnitFloorLen.append(len(fU))

a= iUnitFloorLen
# ---------- end python_2 ----------
partition_2 = PartitionList(List=branch, Size=python_2.a)

smaller = SmallerThan(FirstNumber=python_2.a, SecondNumber=Slider(2, range=0..10))  # -> SmallerThan, OrEqualTo
tstat_2 = TreeStatistics(Tree=partition_2)  # -> Paths, Length, Count
cull = CullPattern(List=tstat_2.Paths, CullPattern=invert(flatten(smaller.SmallerThan)))
branch_2 = TreeBranch(Tree=partition_2, Path=cull, MaintainPaths=True)

end_2 = EndPoints(Curve=branch_2)  # -> Start, End

pdecon = Deconstruct(Point=pt_3)  # -> XComponent, YComponent, ZComponent
bnd = Bounds(Numbers=flatten(pdecon.ZComponent))
dedomain = DeconstructDomain(Domain=bnd)  # -> Start, End

item = ListItem(List=end_2.Start, Index=Slider(1, range=0..1), Wrap=True)
item_2 = ListItem(List=end_2.End, Index=0, Wrap=True)

pt_4 = Point([item, item_2])

pdecon_2 = Deconstruct(Point=pt_4)  # -> XComponent, YComponent, ZComponent
item_3 = ListItem(List=flatten(pdecon.ZComponent), Index=0, Wrap=True)
subtraction = Subtraction(A=item_3, B=pdecon_2.ZComponent)

addition = Addition(A=subtraction, B=Slider(1, range=0..10))
Z_2 = UnitZ(Factor=addition)
move_2 = Move(Geometry=pt_4, Motion=Z_2)  # -> Geometry, Transform
pline_2 = PolyLine(Vertices=move_2.Geometry, Closed=False)  # -> simplify(Polyline)
ln = Line(StartPoint=pt_4, EndPoint=move_2.Geometry)  # -> simplify(Line)

pshift_2 = ShiftPaths(Data=ln, Offset=-1)
pshift_3 = ShiftPaths(Data=pline_2, Offset=-1)
join = JoinCurves(Curves=[branch, pshift_2, pshift_3], Preserve=False)  # -> simplify(Curves)
end_3 = EndPoints(Curve=join)  # -> Start, End
panel = Panel(join)
pdecon_3 = Deconstruct(Point=end_3.Start)  # -> XComponent, YComponent, ZComponent
sort = SortList(Keys=pdecon_3.XComponent, ValuesA=join)  # -> Keys, ValuesA
end_4 = EndPoints(Curve=sort.ValuesA)  # -> Start, End

relitem = RelativeItem(Tree=end_4.End, Offset="{0}[+1]", WrapPaths=False, WrapItems=False)  # -> ItemA, ItemB
relitem_2 = RelativeItem(Tree=end_4.Start, Offset="{0}[+1]", WrapPaths=False, WrapItems=False)  # -> ItemA, ItemB
ln_2 = Line(StartPoint=relitem.ItemA, EndPoint=relitem.ItemB)
ln_3 = Line(StartPoint=relitem_2.ItemA, EndPoint=relitem_2.ItemB)
cull_2 = CullPattern(List=ln_3, CullPattern=[Toggle(True), Toggle(False)])
cull_3 = CullPattern(List=ln_2, CullPattern=[Toggle(False), Toggle(True)])

join_2 = JoinCurves(Curves=[cull_2, cull_3, join], Preserve=False)
end_5 = EndPoints(Curve=join_2)  # -> flatten(Start), flatten(End)
panel_2 = Panel(end_5.End)

relitem_3 = RelativeItem(Tree=end_5.End, Offset="{0}[+1]", WrapPaths=False, WrapItems=False)  # -> ItemA, ItemB
relitem_4 = RelativeItem(Tree=end_5.Start, Offset="{0}[+1]", WrapPaths=False, WrapItems=False)  # -> ItemA, ItemB
ln_4 = Line(StartPoint=relitem_3.ItemA, EndPoint=relitem_3.ItemB)
ln_5 = Line(StartPoint=relitem_4.ItemA, EndPoint=relitem_4.ItemB)
cull_4 = CullPattern(List=ln_5, CullPattern=[Toggle(True), Toggle(False)])
cull_5 = CullPattern(List=ln_4, CullPattern=[Toggle(False), Toggle(True)])

join_3 = JoinCurves(Curves=flatten([cull_4, cull_5, join_2]), Preserve=False)
disc = Discontinuity(Curve=join_3, Level=1)  # -> Points, Parameters
alongcrv = SortAlongCurve(Points=disc.Points, Curve=join_3)  # -> Points, Indices

panel_3 = Panel(alongcrv.Points)
points_2 = PointList(Points=alongcrv.Points)
