# Grasshopper definition robot_abc_parametric.gh (Grasshopper 0.9.76)

xz = XZPlane(Origin=Point(0, 0, 0))
number_slider = Slider(-2.5, range=-30..30)
planesrf = PlaneSurface(Plane=PlaneXY(0, 0, 0), XSize=Slider(10, range=0..30), YSize=Slider(20, range=0..30))
planesrf_2 = PlaneSurface(Plane=PlaneXY(0, 0, 0), XSize=Slider(30, range=0..30), YSize=Slider(20, range=0..30))
X = UnitX(Factor=Slider(24, range=0..24))
cyl = Cylinder(Base=xz, Radius=Slider(6, range=0..6), Length=Slider(8, range=0..8))
boxrec = BoxRectangle(Rectangle=planesrf, Height=Slider(20, range=0..30))
boxrec_2 = BoxRectangle(Rectangle=planesrf_2, Height=Slider(6, range=0..30))
X_2 = UnitX(Factor=Slider(7, range=-30..30))
X_3 = UnitX(Factor=number_slider)
Z = UnitZ(Factor=number_slider)
move = Move(Geometry=cyl, Motion=X)  # -> Geometry, Transform
Y = UnitY(Factor=Slider(28, range=0..30))
move_2 = Move(Geometry=move.Geometry, Motion=Y)  # -> Geometry, Transform
move_3 = Move(Geometry=cyl, Motion=Y)  # -> Geometry, Transform
move_4 = Move(Geometry=boxrec_2, Motion=X_3)  # -> Geometry, Transform
move_5 = Move(Geometry=move_4.Geometry, Motion=Z)  # -> Geometry, Transform
move_6 = Move(Geometry=boxrec, Motion=X_2)  # -> Geometry, Transform
