# Grasshopper definition model.gh (Grasshopper 0.9.76)
# plug-ins: MeshEdit Components, Weaverbird

series = Series(Start=0, Step=Slider(11, range=0..30), Count=10)
series_2 = Series(Start=0, Step=Slider(19, range=0..30), Count=10)
cir = Circle(Plane=PlaneXY(0, 0, 0), Radius=Slider(58, range=0..100))
vec = VectorXYZ(XComponent=0, YComponent=0, ZComponent=series)  # -> Vector, Length
cir_2 = Circle(Plane=PlaneXY(0, 0, 0), Radius=Slider(58, range=0..100))
panel = Panel(vec.Vector)
vec_2 = VectorXYZ(XComponent=0, YComponent=0, ZComponent=series_2)  # -> Vector, Length
panel_2 = Panel(vec_2.Vector)
move = Move(Geometry=cir, Motion=vec.Vector)  # -> Geometry, Transform
pt = Point(<point referenced from the Rhino model>)
area = Area(Geometry=move.Geometry)  # -> Area, Centroid
move_2 = Move(Geometry=cir_2, Motion=vec_2.Vector)  # -> Geometry, Transform
dist = Distance(PointA=area.Centroid, PointB=pt)
pt_2 = Point(<point referenced from the Rhino model>)
pt_3 = Point(<point referenced from the Rhino model>)
area_2 = Area(Geometry=move_2.Geometry)  # -> Area, Centroid
bnd = Bounds(Numbers=dist)
dom = ConstructDomain(DomainStart=Slider(1, range=-6..10), DomainEnd=Slider(5, range=0..5))
dist_2 = Distance(PointA=area_2.Centroid, PointB=pt_2)
dist_3 = Distance(PointA=area_2.Centroid, PointB=pt_3)
bnd_2 = Bounds(Numbers=dist_2)
bnd_3 = Bounds(Numbers=dist_3)
dom_2 = ConstructDomain(DomainStart=Slider(1, range=0..5), DomainEnd=Slider(5, range=0..5))
remap = RemapNumbers(Value=dist, Source=bnd, Target=dom)  # -> Mapped, Clipped
dom_3 = ConstructDomain(DomainStart=Slider(1, range=-6..10), DomainEnd=Slider(5, range=0..5))
graph = GraphMapper(
    remap.Mapped,
    x0=0,
    x1=4,
    y0=0,
    y1=2,
    container_name="Sine",
    Equation_px=[0, 0.5030190349],
    Equation_py=[0.4773126245, 0.8216145635])
remap_2 = RemapNumbers(Value=dist_2, Source=bnd_2, Target=dom_2)  # -> Mapped, Clipped
remap_3 = RemapNumbers(Value=dist_3, Source=bnd_3, Target=dom_3)  # -> Mapped, Clipped
scale = Scale(Geometry=move.Geometry, Center=area.Centroid, Factor=graph)  # -> Geometry, Transform
graph_2 = GraphMapper(
    remap_3.Mapped,
    x0=0,
    x1=4,
    y0=0,
    y1=2,
    container_name="Sine",
    Equation_px=[0.00144980615, 0.8488389254],
    Equation_py=[0.518840611, 0.7055500746])
series_3 = Series(Start=0, Step=Slider(0.16, range=0..1), Count=10)
panel_3 = Panel(scale.Geometry)
rotate = Rotate(Geometry=scale.Geometry, Angle=series_3, Plane=PlaneXY(0, 0, 0))  # -> Geometry, Transform
scale_2 = Scale(Geometry=move_2.Geometry, Center=area_2.Centroid, Factor=graph_2)  # -> Geometry, Transform
series_4 = Series(Start=0, Step=Slider(0.16, range=0..1), Count=10)
loft = Loft(Curves=rotate.Geometry, Options={Adjust=False, Closed=False, LoftEnds=0, LoftSimp=0, LoftType=0, Rebuild=10, Refit=0.01})
panel_4 = Panel(scale_2.Geometry)
rotate_2 = Rotate(Geometry=scale_2.Geometry, Angle=series_4, Plane=PlaneXY(0, 0, 0))  # -> Geometry, Transform
loft_2 = Loft(
    Curves=rotate_2.Geometry,
    Options={Adjust=False, Closed=False, LoftEnds=0, LoftSimp=0, LoftType=0, Rebuild=10, Refit=0.01})
avr = Average(Input=area.Centroid)
cir_3 = Circle(Plane=avr, Radius=Slider(30, range=0..30))

divide = DivideDomain²(Domain=loft_2, UCount=Slider(10, range=0..100), VCount=Slider(30, range=0..100))
subsrf = Isotrim(Surface=loft_2, Domain=divide)

divide_2 = DivideDomain²(Domain=loft, UCount=Slider(3, range=0..100), VCount=Slider(10, range=0..100))
eval = EvaluateCurve(Curve=reparameterize(cir_3), Parameter=Slider(1, range=0..1))  # -> Point, Tangent, Angle
subsrf_2 = Isotrim(Surface=loft, Domain=divide_2)
md_slider = MDSlider(
    slider_value=Point(1, 0.498442173, 0.5),
    SliderMode=0,
    x_domain=Domain(0, 1),
    y_domain=Domain(0, 1),
    z_domain=Domain(0, 1))
evalsrf = EvaluateSurface(Surface=reparameterize(graft(subsrf_2)), Point=md_slider)  # -> Point, Normal, Frame
md_slider_2 = MDSlider(
    slider_value=Point(1, 0.498442173, 0.5),
    SliderMode=0,
    x_domain=Domain(0, 1),
    y_domain=Domain(0, 1),
    z_domain=Domain(0, 1))
pt_4 = Point(evalsrf.Point)
evalsrf_2 = EvaluateSurface(Surface=reparameterize(graft(subsrf)), Point=md_slider_2)  # -> Point, Normal, Frame
pt_5 = Point(evalsrf_2.Point)
dist_4 = Distance(PointA=pt_4, PointB=eval.Point)  # -> simplify(flatten(Distance))
bnd_4 = Bounds(Numbers=dist_4)
dom_4 = ConstructDomain(DomainStart=Slider(5.2, range=0..100), DomainEnd=Slider(28.4, range=0..100))
remap_4 = RemapNumbers(Value=dist_4, Source=bnd_4, Target=dom_4)  # -> Mapped, Clipped
bnd_5 = Bounds(Numbers=dist_4)
dom_5 = ConstructDomain(DomainStart=Slider(20, range=0..100), DomainEnd=Slider(0, range=0..10))
remap_5 = RemapNumbers(Value=dist_4, Source=bnd_5, Target=dom_5)  # -> Mapped, Clipped
neg = Negative(Value=remap_5.Mapped)
larger = LargerThan(FirstNumber=remap_4.Mapped, SecondNumber=Slider(19, range=0..100))  # -> LargerThan, OrEqualTo
dispatch = Dispatch(List=graft(neg), DispatchPattern=graft(larger.LargerThan))  # -> simplify(ListA), simplify(ListB)
dispatch_2 = Dispatch(List=pt_4, DispatchPattern=graft(larger.LargerThan))  # -> ListA, ListB
dispatch_3 = Dispatch(List=simplify(graft(subsrf_2)), DispatchPattern=graft(larger.LargerThan))  # -> simplify(ListA), simplify(ListB)
dispatch_4 = Dispatch(List=simplify(graft(evalsrf.Frame)), DispatchPattern=graft(larger.LargerThan))  # -> simplify(ListA), simplify(ListB)
pt_6 = Point(simplify(dispatch_2.ListB))
pt_7 = Point(simplify(dispatch_2.ListA))
clean = CleanTree(RemoveNulls=True, RemoveInvalid=True, RemoveEmpty=Toggle(True), Tree=dispatch_3.ListA)
clean_2 = CleanTree(RemoveNulls=True, RemoveInvalid=True, RemoveEmpty=Toggle(True), Tree=dispatch_4.ListA)
clean_3 = CleanTree(RemoveNulls=True, RemoveInvalid=True, RemoveEmpty=Toggle(True), Tree=dispatch_4.ListB)
clean_4 = CleanTree(RemoveNulls=True, RemoveInvalid=True, RemoveEmpty=Toggle(True), Tree=dispatch_3.ListB)
clean_5 = CleanTree(RemoveNulls=True, RemoveInvalid=True, RemoveEmpty=Toggle(True), Tree=dispatch.ListA)
clean_6 = CleanTree(RemoveNulls=True, RemoveInvalid=True, RemoveEmpty=Toggle(True), Tree=dispatch.ListB)
clean_7 = CleanTree(RemoveNulls=True, RemoveInvalid=True, RemoveEmpty=Toggle(True), Tree=pt_7)
clean_8 = CleanTree(RemoveNulls=True, RemoveInvalid=True, RemoveEmpty=Toggle(True), Tree=pt_6)
number_slider = Slider(-2, range=-2..0)
explode = Explode(Curve=clean_4, Recursive=True)  # -> simplify(Segments), simplify(Vertices)
explode_2 = Explode(Curve=clean, Recursive=True)  # -> simplify(Segments), simplify(Vertices)
explode_3 = Explode(Curve=explode.Segments, Recursive=True)  # -> Segments, simplify(Vertices)
line = LineSDL(Start=clean_8, Direction=clean_3, Length=clean_6)
item = ListItem(List=explode_2.Vertices, Index=0, Wrap=True)
item_2 = ListItem(List=explode_2.Vertices, Index=Slider(1, range=0..3), Wrap=True)
item_3 = ListItem(List=explode_2.Vertices, Index=Slider(2, range=0..3), Wrap=True)
item_4 = ListItem(List=explode_2.Vertices, Index=Slider(3, range=0..3), Wrap=True)
end = EndPoints(Curve=line)  # -> Start, End
pt_8 = Point(simplify(end.End))
item_5 = ListItem(List=explode_3.Vertices, Index=0, Wrap=True)
item_6 = ListItem(List=explode_3.Vertices, Index=Slider(1, range=0..1), Wrap=True)
panel_5 = Panel(explode_3.Vertices)
repeat = RepeatData(Data=pt_8, Length=Slider(4, range=0..10))  # -> graft(Data)
path_mapper = PathMapper(repeat, source="{A;B;C}", target="{A;C}")
triangle = MeshTriangle(CornerA=0, CornerB=1, CornerC=2)
quad = MeshQuad(CornerA=0, CornerB=1, CornerC=2, CornerD=3)
conmesh = ConstructMesh(Vertices=[item, item_2, item_3, item_4], Faces=quad)
conmesh_2 = ConstructMesh(Vertices=[path_mapper, item_5, item_6], Faces=triangle)
flip = MeshFlip(Mesh=conmesh_2)
flip_2 = MeshFlip(Mesh=conmesh)
mesh = Mesh(flip)
mesh_2 = Mesh(flip_2)
wbframe = WeaverbirdsPictureFrame(MeshPolylines=mesh_2, Distance=Slider(19, range=0..100), InsetType=Slider(0.3, range=0..1))
mjoin = MeshJoin(Meshes=flatten([mesh, wbframe]))
panel_6 = Panel(mesh_2)
panel_7 = Panel(mesh)
medges = MeshEdges(Mesh=mjoin)  # -> NakedEdges, InteriorEdges, NonManifoldEdges
crv = Curve(medges.NakedEdges)
join = JoinCurves(Curves=crv, Preserve=False)
panel_8 = Panel(join)
number_slider_2 = Slider(0.7, range=0..1)
number_slider_3 = Slider(0.7, range=0..1)
scale_nu = ScaleNU(Geometry=mjoin, Plane=PlaneXY(0, 0, 0), ScaleX=number_slider_2, ScaleY=number_slider_2, ScaleZ=Slider(0.8, range=0..1))  # -> Geometry, Transform
mjoin_2 = MeshJoin(Meshes=flatten(scale_nu.Geometry))
medges_2 = MeshEdges(Mesh=mjoin_2)  # -> NakedEdges, InteriorEdges, NonManifoldEdges
crv_2 = Curve(medges_2.NakedEdges)
join_2 = JoinCurves(Curves=crv_2, Preserve=False)
join_3 = JoinCurves(Curves=crv_2, Preserve=False)
item_7 = ListItem(List=join, Index=0, Wrap=True)
item_8 = ListItem(List=reverse(join_2), Index=0, Wrap=True)
item_9 = ListItem(List=reverse(join), Index=0, Wrap=True)
item_10 = ListItem(List=join_3, Index=0, Wrap=True)
explode_4 = Explode(Curve=join, Recursive=True)  # -> graft(Segments), Vertices
explode_5 = Explode(Curve=join_3, Recursive=True)  # -> graft(Segments), Vertices
explode_6 = Explode(Curve=item_8, Recursive=True)  # -> graft(Segments), Vertices
explode_7 = Explode(Curve=item_9, Recursive=True)  # -> graft(Segments), Vertices
panel_10 = Panel(explode_4.Vertices)
panel_11 = Panel(explode_5.Segments)
end_2 = EndPoints(Curve=explode_4.Segments)  # -> Start, End
end_3 = EndPoints(Curve=explode_5.Segments)  # -> Start, End
end_4 = EndPoints(Curve=explode_6.Segments)  # -> Start, End
end_5 = EndPoints(Curve=explode_7.Segments)  # -> Start, End
quad_2 = MeshQuad(CornerA=0, CornerB=1, CornerC=2, CornerD=3)
quad_3 = MeshQuad(CornerA=0, CornerB=1, CornerC=2, CornerD=3)
conmesh_3 = ConstructMesh(Vertices=[end_2.Start, end_2.End, end_3.End, end_3.Start], Faces=quad_2)  # -> flatten(Mesh)
conmesh_4 = ConstructMesh(Vertices=[end_5.Start, end_5.End, end_4.End, end_4.Start], Faces=quad_3)
quad_4 = MeshQuad(CornerA=0, CornerB=1, CornerC=2, CornerD=3)
flip_3 = MeshFlip(Mesh=conmesh_4)  # -> flatten(Mesh)
mjoin_3 = MeshJoin(Meshes=flatten([conmesh_3, mjoin_2, mjoin]))
wbcatmullclark = WeaverbirdsCatmullClarkSubdivision(MeshCurves=mjoin_3, Level=Slider(2, range=0..10), SmoothNakedEdges=Slider(1, range=0..2))

avr_2 = Average(Input=area_2.Centroid)
cir_4 = Circle(Plane=avr_2, Radius=Slider(30, range=0..30))

eval_2 = EvaluateCurve(Curve=reparameterize(cir_4), Parameter=Slider(1, range=0..1))  # -> Point, Tangent, Angle

dist_5 = Distance(PointA=pt_5, PointB=eval_2.Point)  # -> simplify(flatten(Distance))

bnd_6 = Bounds(Numbers=dist_5)
dom_6 = ConstructDomain(DomainStart=Slider(5.2, range=0..100), DomainEnd=Slider(28.4, range=0..100))
remap_6 = RemapNumbers(Value=dist_5, Source=bnd_6, Target=dom_6)  # -> Mapped, Clipped

ln = Line(StartPoint=pt_5, EndPoint=eval_2.Point)

bnd_7 = Bounds(Numbers=dist_5)
dom_7 = ConstructDomain(DomainStart=Slider(20, range=0..100), DomainEnd=Slider(0, range=0..10))
remap_7 = RemapNumbers(Value=dist_5, Source=bnd_7, Target=dom_7)  # -> Mapped, Clipped

neg_2 = Negative(Value=remap_7.Mapped)
larger_2 = LargerThan(FirstNumber=remap_6.Mapped, SecondNumber=Slider(19, range=0..100))  # -> LargerThan, OrEqualTo

# ---- group: distance
dispatch_5 = Dispatch(List=graft(neg_2), DispatchPattern=graft(larger_2.LargerThan))  # -> simplify(ListA), simplify(ListB)
clean_9 = CleanTree(RemoveNulls=True, RemoveInvalid=True, RemoveEmpty=Toggle(True), Tree=dispatch_5.ListA)
clean_10 = CleanTree(RemoveNulls=True, RemoveInvalid=True, RemoveEmpty=Toggle(True), Tree=dispatch_5.ListB)

# ---- group: punti
dispatch_6 = Dispatch(List=pt_5, DispatchPattern=graft(larger_2.LargerThan))  # -> ListA, ListB
pt_9 = Point(simplify(dispatch_6.ListB))
pt_10 = Point(simplify(dispatch_6.ListA))

# ---- group: surface
dispatch_7 = Dispatch(List=simplify(graft(subsrf)), DispatchPattern=graft(larger_2.LargerThan))  # -> simplify(ListA), simplify(ListB)
clean_11 = CleanTree(RemoveNulls=True, RemoveInvalid=True, RemoveEmpty=Toggle(True), Tree=dispatch_7.ListA)
clean_12 = CleanTree(RemoveNulls=True, RemoveInvalid=True, RemoveEmpty=Toggle(True), Tree=dispatch_7.ListB)

# ---- group: normal
dispatch_8 = Dispatch(List=simplify(graft(evalsrf_2.Frame)), DispatchPattern=graft(larger_2.LargerThan))  # -> simplify(ListA), simplify(ListB)
clean_13 = CleanTree(RemoveNulls=True, RemoveInvalid=True, RemoveEmpty=Toggle(True), Tree=dispatch_8.ListA)
clean_14 = CleanTree(RemoveNulls=True, RemoveInvalid=True, RemoveEmpty=Toggle(True), Tree=dispatch_8.ListB)

# ---- group: punti
clean_15 = CleanTree(RemoveNulls=True, RemoveInvalid=True, RemoveEmpty=Toggle(True), Tree=pt_10)
clean_16 = CleanTree(RemoveNulls=True, RemoveInvalid=True, RemoveEmpty=Toggle(True), Tree=pt_9)

# ----
number_slider_4 = Slider(-2, range=-2..0)
line_2 = LineSDL(Start=clean_16, Direction=clean_14, Length=clean_10)
end_6 = EndPoints(Curve=line_2)  # -> Start, End

explode_8 = Explode(Curve=clean_12, Recursive=True)  # -> simplify(Segments), simplify(Vertices)
explode_9 = Explode(Curve=explode_8.Segments, Recursive=True)  # -> Segments, simplify(Vertices)

explode_10 = Explode(Curve=clean_11, Recursive=True)  # -> simplify(Segments), simplify(Vertices)
item_11 = ListItem(List=explode_10.Vertices, Index=0, Wrap=True)
item_12 = ListItem(List=explode_10.Vertices, Index=Slider(1, range=0..3), Wrap=True)
item_13 = ListItem(List=explode_10.Vertices, Index=Slider(2, range=0..3), Wrap=True)
item_14 = ListItem(List=explode_10.Vertices, Index=Slider(3, range=0..3), Wrap=True)
pt_11 = Point(simplify(end_6.End))
item_15 = ListItem(List=explode_9.Vertices, Index=0, Wrap=True)
item_16 = ListItem(List=explode_9.Vertices, Index=Slider(1, range=0..1), Wrap=True)
panel_12 = Panel(explode_9.Vertices)
repeat_2 = RepeatData(Data=pt_11, Length=Slider(4, range=0..10))  # -> graft(Data)
path_mapper_2 = PathMapper(repeat_2, source="{A;B;C}", target="{A;C}")

triangle_2 = MeshTriangle(CornerA=0, CornerB=1, CornerC=2)
conmesh_5 = ConstructMesh(Vertices=[path_mapper_2, item_15, item_16], Faces=triangle_2)

quad_5 = MeshQuad(CornerA=0, CornerB=1, CornerC=2, CornerD=3)
conmesh_6 = ConstructMesh(Vertices=[item_11, item_12, item_13, item_14], Faces=quad_5)

flip_4 = MeshFlip(Mesh=conmesh_5)
flip_5 = MeshFlip(Mesh=conmesh_6)
mesh_3 = Mesh(flip_4)
mesh_4 = Mesh(flip_5)

mjoin_4 = MeshJoin(Meshes=flatten([mesh_3, mesh_4]))
medges_3 = MeshEdges(Mesh=mjoin_4)  # -> NakedEdges, InteriorEdges, NonManifoldEdges
crv_3 = Curve(medges_3.NakedEdges)
join_4 = JoinCurves(Curves=crv_3, Preserve=False)
area_3 = MeshArea(Mesh=join_4)  # -> Area, Centroid
item_17 = ListItem(List=area_3.Centroid, Index=0, Wrap=True)

panel_13 = Panel(mesh_3)
panel_14 = Panel(mesh_4)
panel_15 = Panel(join_4)
scale_nu_2 = ScaleNU(Geometry=mjoin_4, Plane=PlaneXY(0, 0, 0), ScaleX=number_slider_3, ScaleY=number_slider_3, ScaleZ=Slider(0.8, range=0..1))  # -> Geometry, Transform
mjoin_5 = MeshJoin(Meshes=flatten(scale_nu_2.Geometry))
medges_4 = MeshEdges(Mesh=mjoin_5)  # -> NakedEdges, InteriorEdges, NonManifoldEdges
crv_4 = Curve(medges_4.NakedEdges)
join_5 = JoinCurves(Curves=crv_4, Preserve=False)
join_6 = JoinCurves(Curves=crv_4, Preserve=False)
item_18 = ListItem(List=join_4, Index=0, Wrap=True)
item_19 = ListItem(List=reverse(join_6), Index=0, Wrap=True)
item_20 = ListItem(List=reverse(join_4), Index=0, Wrap=True)
item_21 = ListItem(List=join_5, Index=0, Wrap=True)
explode_11 = Explode(Curve=item_21, Recursive=True)  # -> graft(Segments), Vertices
explode_12 = Explode(Curve=item_19, Recursive=True)  # -> graft(Segments), Vertices
explode_13 = Explode(Curve=item_18, Recursive=True)  # -> graft(Segments), Vertices
explode_14 = Explode(Curve=item_20, Recursive=True)  # -> graft(Segments), Vertices
panel_17 = Panel(explode_13.Vertices)
end_7 = EndPoints(Curve=explode_11.Segments)  # -> Start, End
end_8 = EndPoints(Curve=explode_12.Segments)  # -> Start, End
end_9 = EndPoints(Curve=explode_13.Segments)  # -> Start, End
end_10 = EndPoints(Curve=explode_14.Segments)  # -> Start, End

# ---- group: elegance
quad_6 = MeshQuad(CornerA=0, CornerB=1, CornerC=2, CornerD=3)
conmesh_7 = ConstructMesh(Vertices=[end_9.Start, end_9.End, end_7.End, end_7.Start], Faces=quad_6)  # -> flatten(Mesh)

# ---- group: soluzione facile e sbagliata!
loft_3 = Loft(
    Curves=[item_18, item_21],
    Options={Adjust=False, Closed=False, LoftEnds=0, LoftSimp=0, LoftType=0, Rebuild=10, Refit=0.01})  # disabled
smesh = SimpleMesh(Brep=loft_3)  # disabled
mesh_5 = MeshBrep(
    Brep=loft_3,
    Settings={GridMaxCount=0, GridMinCount=16, JaggedSeams=False, MaxEdgeLength=0, MinEdgeLength=0.0001, MinTolerance=0, Refine=True, RefineAngle=0, RelativeTolerance=0.65, SimplePlanes=True, Tolerance=0})  # disabled

# ----
conmesh_8 = ConstructMesh(Vertices=[end_10.Start, end_10.End, end_8.End, end_8.Start], Faces=quad_4)
flip_6 = MeshFlip(Mesh=conmesh_8)  # -> flatten(Mesh)
mjoin_6 = MeshJoin(Meshes=flatten([conmesh_7, flip_6, mjoin_5, mjoin_4]))
wbcatmullclark_2 = WeaverbirdsCatmullClarkSubdivision(MeshCurves=mjoin_6, Level=Slider(2, range=0..10), SmoothNakedEdges=Slider(1, range=0..2))
